# Grasshopper definition parametric-tree.gh (Grasshopper 1.0.7)

# ---- group: conifer
tree_height = Slider(30, range=0..36)
canopy_diameter = Slider(17, range=0..36)
canopy_divisions = Slider(3, range=0..36)
trunk_height = Slider(8, range=0..36)
trunk_diameter = Slider(1.5, range=0..3)
conifer = Conifer(
    relay=trunk_diameter,
    factor=trunk_height,
    factor_2=tree_height,
    A=canopy_diameter,
    A_2=tree_height,
    B=canopy_divisions,
    steps=canopy_divisions)  # -> pipe_2, result
canopy_color = ColourSwatch(SwatchColor=RGBA(58, 94, 78, 232))
trunk_color = ColourSwatch(SwatchColor=RGB(139, 76, 57))
custom_preview = CustomPreview(Geometry=conifer.pipe_2, Material=trunk_color)
custom_preview_2 = CustomPreview(Geometry=conifer.result, Material=canopy_color)

# ---- group: conical conifer
# parametric tree
trunk_diameter_2 = Slider(1.5, range=0..3)
trunk_height_2 = Slider(8, range=0..36)
canopy_divisions_2 = Slider(3, range=0..36)
tree_height_2 = Slider(30, range=0..36)
canopy_diameter_2 = Slider(17, range=0..36)
unit_z = UnitZ(Factor=trunk_height_2)
construct_point = ConstructPoint(XCoordinate=0, YCoordinate=0, ZCoordinate=0)
unit_z_2 = UnitZ(Factor=tree_height_2)
division = Division(A=canopy_diameter_2, B=4)
division_2 = Division(A=tree_height_2, B=canopy_divisions_2)
move = Move(Geometry=construct_point, Motion=unit_z)  # -> Geometry, Transform
move_2 = Move(Geometry=construct_point, Motion=unit_z_2)  # -> Geometry, Transform
line = Line(StartPoint=move.Geometry, EndPoint=move_2.Geometry)
line_2 = Line(StartPoint=construct_point, EndPoint=move.Geometry)
divide_distance = DivideDistance(Curve=line, Distance=division_2)  # -> Points, Tangents, Parameters
pipe = Pipe(Curve=line_2, Radius=expr("x/2", trunk_diameter_2), Caps=1)
construct_domain = ConstructDomain(DomainStart="0.75", DomainEnd="2")
range = Range(Domain=construct_domain, Steps=expr("x-1", canopy_divisions_2))  # -> reverse(Range)
cone = Cone(Base=divide_distance.Points, Radius=division, Length=division_2)  # -> Cone, Tip
scale = Scale(Geometry=cone.Cone, Center=divide_distance.Points, Factor=range)  # -> Geometry, Transform
cap_holes = CapHoles(Brep=scale.Geometry)
solid_union = SolidUnion(Breps=cap_holes)
trunk_color_2 = ColourSwatch(SwatchColor=RGB(139, 76, 57))
canopy_color_2 = ColourSwatch(SwatchColor=RGBA(58, 94, 84, 232))
custom_preview_3 = CustomPreview(Geometry=pipe, Material=trunk_color_2)
custom_preview_4 = CustomPreview(Geometry=solid_union, Material=canopy_color_2)

# ==== cluster Conifer
factor = ClusterInput()
factor_2 = ClusterInput()
relay = ClusterInput()
A = ClusterInput()
steps = ClusterInput()
A_2 = ClusterInput()
B = ClusterInput()
unit_z = UnitZ(Factor=factor)
construct_point = ConstructPoint(XCoordinate=0, YCoordinate=0, ZCoordinate=0)
unit_z_2 = UnitZ(Factor=factor_2)
division = Division(A=A, B=4)
division_2 = Division(A=A_2, B=B)
move = Move(Geometry=construct_point, Motion=unit_z)  # -> Geometry, Transform
move_2 = Move(Geometry=construct_point, Motion=unit_z_2)  # -> Geometry, Transform
line = Line(StartPoint=move.Geometry, EndPoint=move_2.Geometry)
line_2 = Line(StartPoint=construct_point, EndPoint=move.Geometry)
divide_distance = DivideDistance(Curve=line, Distance=division_2)  # -> Points, Tangents, Parameters
pipe = Pipe(Curve=line_2, Radius=expr("x/2", relay), Caps=1)
pipe_2 = ClusterOutput(pipe)
construct_domain = ConstructDomain(DomainStart="0.75", DomainEnd="2")
range = Range(Domain=construct_domain, Steps=expr("x-1", steps))  # -> reverse(Range)
cone = Cone(Base=divide_distance.Points, Radius=division, Length=division_2)  # -> Cone, Tip
scale = Scale(Geometry=cone.Cone, Center=divide_distance.Points, Factor=range)  # -> Geometry, Transform
cap_holes = CapHoles(Brep=scale.Geometry)
solid_union = SolidUnion(Breps=cap_holes)
result = ClusterOutput(solid_union)
