# Grasshopper definition random-meadow.gh (Grasshopper 1.0.7)
# plug-ins: Pufferfish, EleFront, EdiTree

# ---- group: randomly distribute meadow plants / import thea plant(s)
# random meadow
# using elefront
extended_geometry = ExtendedGeometry([<elefrontblock referenced from the Rhino model> x5])

# ----
list_length = ListLength(List=extended_geometry)
define_object_attributes = DefineObjectAttributes(Layer="Plants")

# ---- group: randomly distribute meadow plants
# using pufferfish
# using editree
count = Slider(2500, range=0..10000)
radius = Slider(5, range=0..10)
thickness = Slider(-0.125, range=-1..0)
circle = Circle(Plane=PlaneXY(0, 0, 0), Radius=radius)
unit_z = UnitZ(Factor=thickness)
boundary_surfaces = BoundarySurfaces(Edges=circle)
populate_geometry = PopulateGeometry(Geometry=boundary_surfaces, Count=count, Seed=1)
divide_list = DivideList(List=extended_geometry, Number=list_length)  # -> Chunk, Remainder
divide_list_2 = DivideList(List=populate_geometry, Number=list_length)  # -> Chunk, Remainder
move_to_point = MoveToPoint(Geometry=divide_list.Chunk, PointA=Point(0, 0, 0), PointB=divide_list_2.Chunk)  # -> Moved, Vector, Transform
random = Random(Range="0.5 To 1.0", Number=count, Seed=2)
scale = Scale(Geometry=flatten(move_to_point.Moved), Center=flatten(move_to_point.Vector), Factor=random)  # -> Geometry, Transform
define_object_attributes_2 = DefineObjectAttributes(Layer="Ground")

# ----
scale_2 = Scale(Geometry=boundary_surfaces, Center=Point(0, 0, 0), Factor="1.025")  # -> Geometry, Transform
random_2 = Random(Range="0 To 360", Number=count, Seed=2)
rotate = Rotate(Geometry=scale.Geometry, Angle=degrees(random_2), Plane=PlaneXY(0, 0, 0))  # -> Geometry, Transform

# ---- group: randomly distribute meadow plants (continued)
extrude = Extrude(Base=scale_2.Geometry, Direction=unit_z)
bake_objects = BakeObjects(Geometry=rotate.Geometry, Attributes=define_object_attributes, Bake=False)
bake_objects_2 = BakeObjects(Geometry=extrude, Attributes=define_object_attributes_2, Bake=False)
