# Grasshopper definition strange-attractor.gh (Grasshopper 1.0.7)
# plug-ins: EleFront, Chen System

# ---- group: chen system strange attractor
# strange attractor
# using chimpanzee
number_slider = Slider(44, range=0..100)
chen_system = ChenSystem(A=number_slider, Iterations=Slider(50000, range=0..100000))
interpolate = Interpolate(Vertices=chen_system, Degree=3, Periodic=False, KnotStyle=1)  # -> Curve, Length, Domain

# ---- group: variable pipe
# run
# using elefront
slider = Slider(0.4, range=0..8)
data_dam = DataDam(DataDataA=interpolate.Curve, BufferDelay=10000000, BufferMode=0)
relay = Relay([Slider(1.6, range=0..8), slider, Slider(0.1, range=0..8)])
list_length = ListLength(List=relay)
divide = DivideCurve(Curve=data_dam, Count=expr("x-1", list_length), Kinks=False)  # -> Points, Tangents, Parameters
vpipe = PipeVariable(Curve=data_dam, Parameters=divide.Parameters, Radii=relay, Caps=2)
bake_objects = BakeObjects(Geometry=vpipe, Bake=False)
custom_preview = CustomPreview(Geometry=vpipe, Material=ColourSwatch(SwatchColor=RGB(255, 255, 255)))
