# Grasshopper definition terrain-analysis.gh (Grasshopper 1.0.7)
# plug-ins: Pufferfish, Docofossor, Section To XY

# ---- group: import xyz data as grid
# import terrain
# using docofossor
file_path = FilePath("D:\rhino\grasshopper\elevation.xyz")
import_xyz = ImportXYZ(F=file_path)
grid_shift = GridShift(Df=import_xyz)
grid_mesh = GridMesh(Df=grid_shift)
custom_preview = CustomPreview(Geometry=grid_mesh, Material=ColourSwatch(SwatchColor=RGB(230, 230, 230)))

# ---- group: model flowlines
# analyze terrain
# using bison
resolution = Slider(10, range=1..10)
grid_filter = GridFilter(Df=grid_shift, N=resolution)
grid_mesh_2 = GridMesh(Df=grid_filter)
bounding_rectangle = BoundingRectangle(Geometry=grid_mesh_2, Plane=PlaneXY(0, 0, 0), Axis=0, Slide=0, Union=True)  # -> Bounding, DimensionX, DimensionY
flow = Flow(Boundary=bounding_rectangle.Bounding, Mesh=grid_mesh_2, Grid="1", Steps="20", Length="0.5")
custom_preview_2 = CustomPreview(Geometry=flow, Material=ColourSwatch(SwatchColor=RGB(0, 0, 0)))

# ---- group: compute aspect
# using bison
control_knob = ControlKnob(Decimals=0, Limit=True, Maximum=360, Minimum=0, Range=360, Value=270)
geometry = Geometry(grid_mesh)
aspect = Aspect(Mesh=geometry, Angle=control_knob)  # -> Mesh, Colors, Tags, Aspect
legend = Legend(Colour=aspect.Colors, Tags=aspect.Tags, LegendType=1)
