# Grasshopper definition terrain-modeling.gh (Grasshopper 1.0.7)
# plug-ins: Docofossor

# ---- group: import xyz data as grid
# import terrain
# using docofossor
file_path = FilePath("D:\rhino\grasshopper\elevation.xyz")
import_xyz = ImportXYZ(F=file_path)
grid_shift = GridShift(Df=import_xyz)
grid_mesh = GridMesh(Df=grid_shift)
custom_preview = CustomPreview(Geometry=grid_mesh, Material=ColourSwatch(SwatchColor=RGB(230, 230, 230)))

# ---- group: vector flow field
# analyze terrain
grid_filter = GridFilter(Df=grid_shift, N="10")
grid_smooth = GridSmooth(Df=grid_filter, Rad="2")
grid_points = GridPoints(Df=grid_smooth)
slope_vectors = SlopeVectors(Df=grid_smooth)
reverse = Reverse(Vector=slope_vectors)
vector_display = VectorDisplay(Anchor=grid_points, Vector=reverse)
